% Simulink data dictionary Drivetrain.sldd

CtrlTcuDnLdBpt = Simulink.Parameter([0.1 0.4 0.5 0.9])
CtrlTcuTmDnSh = Simulink.Parameter(0.5)
CtrlTcuTmUpSh = Simulink.Parameter(0.5)
CtrlTcuUpLdBpt = Simulink.Parameter([0.1 0.4 0.5 0.9])
PlntCltch1AppPrsArea = 0.03141593
PlntCltch1DerateFctr = 1
PlntCltch1EngdPrs = 0
PlntCltch1InDamp = 0.003
PlntCltch1InInertia = 0.21
PlntCltch1InitInVel = 0
PlntCltch1InitOutVel = 0
PlntCltch1KinFric = 0.4
PlntCltch1NumDisk = 1
PlntCltch1OutDamp = 0.003
PlntCltch1OutInertia = 0.01
PlntCltch1Prs = 300000
PlntCltch1Radius = 0.11
PlntCltch1StatFric = 0.45
PlntCltch1TimeCnst = 0.25
PlntDiffrntl2Axl1Damp = 0.001
PlntDiffrntl2Axl1Inertia = 0.1
PlntDiffrntl2Axl1InitVel = 0
PlntDiffrntl2Axl2Damp = 0.001
PlntDiffrntl2Axl2Inertia = 0.1
PlntDiffrntl2Axl2InitVel = 0
PlntDiffrntl2CarrDamp = 0.001
PlntDiffrntl2CarrInertia = 0.1
PlntDiffrntl2Cltch1CaseGearRatio = 0.875
PlntDiffrntl2Cltch2CaseGearRatio = 1.125
PlntDiffrntl2CltchAppPrsArea = 0.01
PlntDiffrntl2CltchAxl1CarrGearRatio = 1.125
PlntDiffrntl2CltchAxl1CarrInertia = 0.001
PlntDiffrntl2CltchAxl1RingInertia = 0.002
PlntDiffrntl2CltchAxl1SunGearInertia = 0.001
PlntDiffrntl2CltchAxl2CarrGearRatio = 1.125
PlntDiffrntl2CltchAxl2CarrInertia = 0.001
PlntDiffrntl2CltchAxl2RingInertia = 0.002
PlntDiffrntl2CltchAxl2SunGearInertia = 0.001
PlntDiffrntl2CltchCplngTimeCnst = 0.04
PlntDiffrntl2CltchFricVect = [0.16 0.13 0.115 0.11 0.105 0.1025 0.10125 0.10125]
PlntDiffrntl2CltchInTrqVect = [-200 -175 -150 0 50 100 175 200]
PlntDiffrntl2CltchNumDisk = 4
PlntDiffrntl2CltchPreloadForce = 1000
PlntDiffrntl2CltchPrsVect = [0 1000 5000 7000 10000 20000 50000 100000 500000 1000000 5000000]
PlntDiffrntl2CltchRadius = 0.08
PlntDiffrntl2CltchSlipSpdVect = [-200 -175 -100 -50 0 50 100 175 200]
PlntDiffrntl2CltchSpdVect = [0 10 20 40 60 80 100 1000]
PlntDiffrntl2CltchStatFric = 0.35
PlntDiffrntl2CltchTrqInTrqVect = [-200 -175 -150 0 50 100 175 200]
PlntDiffrntl2CltchTrqSlipSpdVect = [-100 -90 -50 -5 0 5 50 90 100]
PlntDiffrntl2Eff = 0.98
PlntDiffrntl2EffSpdBpt = [52.4 78.5 105 131 157 183 209 262 314 419 524]
PlntDiffrntl2EffTbl = reshape([0.64 0.76 0.8 0.81 0.83 0.84 0.84 0.56 0.73 0.78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], 7, 11, 2)
PlntDiffrntl2EffTempBpt = [290 358]
PlntDiffrntl2EffTrqBpt = [25 50 75 100 150 200 250]
PlntDiffrntl2ThreeGangGearInertia = 0.003
PlntDiffrntlAxl1Damp = 0.001
PlntDiffrntlAxl1Inertia = 0.1
PlntDiffrntlAxl1InitVel = 0
PlntDiffrntlAxl2Damp = 0.001
PlntDiffrntlAxl2Inertia = 0.1
PlntDiffrntlAxl2InitVel = 0
PlntDiffrntlCarrDamp = 0.001
PlntDiffrntlCarrInertia = 0.1
PlntDiffrntlCltch1CaseGearRatio = 0.875
PlntDiffrntlCltch2CaseGearRatio = 1.125
PlntDiffrntlCltchAppPrsArea = 0.01
PlntDiffrntlCltchAxl1CarrGearRatio = 1.125
PlntDiffrntlCltchAxl1CarrInertia = 0.001
PlntDiffrntlCltchAxl1RingInertia = 0.002
PlntDiffrntlCltchAxl1SunGearInertia = 0.001
PlntDiffrntlCltchAxl2CarrGearRatio = 1.125
PlntDiffrntlCltchAxl2CarrInertia = 0.001
PlntDiffrntlCltchAxl2RingInertia = 0.002
PlntDiffrntlCltchAxl2SunGearInertia = 0.001
PlntDiffrntlCltchCplngTimeCnst = 0.04
PlntDiffrntlCltchFricVect = [0.16 0.13 0.115 0.11 0.105 0.1025 0.10125 0.10125]
PlntDiffrntlCltchInTrqVect = [-200 -175 -150 0 50 100 175 200]
PlntDiffrntlCltchNumDisk = 4
PlntDiffrntlCltchPreloadForce = 1000
PlntDiffrntlCltchPrsVect = [0 1000 5000 7000 10000 20000 50000 100000 500000 1000000 5000000]
PlntDiffrntlCltchRadius = 0.08
PlntDiffrntlCltchSlipSpdVect = [-200 -175 -100 -50 0 50 100 175 200]
PlntDiffrntlCltchSpdVect = [0 10 20 40 60 80 100 1000]
PlntDiffrntlCltchStatFric = 0.35
PlntDiffrntlCltchTrqInTrqVect = [-200 -175 -150 0 50 100 175 200]
PlntDiffrntlCltchTrqSlipSpdVect = [-100 -90 -50 -5 0 5 50 90 100]
PlntDiffrntlEff = 0.98
PlntDiffrntlEffSpdBpt = [52.4 78.5 105 131 157 183 209 262 314 419 524]
PlntDiffrntlEffTbl = reshape([0.64 0.76 0.8 0.81 0.83 0.84 0.84 0.56 0.73 0.78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], 7, 11, 2)
PlntDiffrntlEffTempBpt = [290 358]
PlntDiffrntlEffTrqBpt = [25 50 75 100 150 200 250]
PlntDiffrntlP0Ratio = 3
PlntDiffrntlRatio = 3.32
PlntDiffrntlThreeGangGearInertia = 0.003
PlntDriveshftDampRatio = 0.01
PlntDriveshftInertia = 0.02
PlntDriveshftInitDeflect = 0
PlntDriveshftInitVel = 0
PlntDriveshftMinNumFlexElmnt = 1
PlntDriveshftStiff = 5000
PlntDriveshftViscFric = [0 0]
PlntEMWhlGearEffFL = 0.98
PlntEMWhlGearEffFR = 0.98
PlntEMWhlGearEffRL = 0.98
PlntEMWhlGearEffRR = 0.98
PlntEMWhlGearInDampFL = 0.001
PlntEMWhlGearInDampFR = 0.001
PlntEMWhlGearInDampRL = 0.001
PlntEMWhlGearInDampRR = 0.001
PlntEMWhlGearInInertiaFL = 0.01
PlntEMWhlGearInInertiaFR = 0.01
PlntEMWhlGearInInertiaRL = 0.01
PlntEMWhlGearInInertiaRR = 0.01
PlntEMWhlGearInInitVelFL = 0
PlntEMWhlGearInInitVelFR = 0
PlntEMWhlGearInInitVelRL = 0
PlntEMWhlGearInInitVelRR = 0
PlntEMWhlGearOutDampFL = 0.001
PlntEMWhlGearOutDampFR = 0.001
PlntEMWhlGearOutDampRL = 0.001
PlntEMWhlGearOutDampRR = 0.001
PlntEMWhlGearOutInertiaFL = 0.01
PlntEMWhlGearOutInertiaFR = 0.01
PlntEMWhlGearOutInertiaRL = 0.01
PlntEMWhlGearOutInertiaRR = 0.01
PlntEMWhlGearRatioFL = 4.1
PlntEMWhlGearRatioFR = 4.1
PlntEMWhlGearRatioRL = 4.1
PlntEMWhlGearRatioRR = 4.1
PlntHevIpsP1CarrDamp = 0.005
PlntHevIpsP1CarrInertia = 0.21
PlntHevIpsP1InitCarrVel = 0
PlntHevIpsP1InitSunVel = 0
PlntHevIpsP1PlanetDamp = 0.005
PlntHevIpsP1PlanetInertia = 0.01
PlntHevIpsP1RingDamp = 0.005
PlntHevIpsP1RingInertia = 0.03
PlntHevIpsP1SunDamp = 0.005
PlntHevIpsP1SunInertia = 0.01
PlntHevIpsP1SunPlanetRatio = 1.304348
PlntHevIpsP1SunRingRatio = 0.3846154
PlntHevIpsP2Eff = 0.98
PlntHevIpsP2GearRatio = 2.636364
PlntHevIpsP2InDamp = 0.005
PlntHevIpsP2InInertia = 0.01
PlntHevIpsP2InInitVel = 0
PlntHevIpsP2OutDamp = 0.005
PlntHevIpsP2OutInertia = 0.01
PlntHevMmCltchInInertia = 0.01
PlntHevMmCltchPrs = 600000
PlntHevMmCltchTimeCnst = 0.01
PlntHevMmEngDamp = 0.001
PlntHevMmEngInertia = 0.21
PlntHevMmEngInitVel = 0
PlntHevMmGenGearEff = 0.98
PlntHevMmGenGearInDamp = 0.001
PlntHevMmGenGearInInertia = 0.01
PlntHevMmGenGearInitVel = 0
PlntHevMmGenGearOutDamp = 0.001
PlntHevMmGenGearOutInertia = 0.01
PlntHevMmGenGearRatio = 1.23
PlntHevMmMotGearEff = 0.98
PlntHevMmMotGearInDamp = 0.001
PlntHevMmMotGearInInertia = 0.01
PlntHevMmMotGearInitVel = 0
PlntHevMmMotGearOutDamp = 0.001
PlntHevMmMotGearOutInertia = 0.01
PlntHevMmMotGearRatio = 2.45
PlntP0GearViscFric = [0 0]
PlntTransB = Simulink.Parameter(200)
PlntTransCltchForceGain = 5000
PlntTransCltchKinFric = 0.4
PlntTransCltchKinFricTrq = 4000
PlntTransCltchPrsTimeCnst = 0.02
PlntTransCltchRadius = 0.2
PlntTransCltchStatFric = 0.6
PlntTransCltchSyncTime = 0.25
PlntTransCltchTime = 0.5
PlntTransDampVect = repmat(0.003, 1, 9)
PlntTransEffSpdBpt = [52 524]
PlntTransEffTbl = reshape([0.9 0.9 0.9 0.9 0.86 0.85 0.87 0.86 0.865 0.855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], 2, 2, 9, 2)
PlntTransEffTempBpt = [313 358]
PlntTransEffTrqBpt = [25 250]
PlntTransEffVect = repmat(0.9, 1, 9)
PlntTransGearNumVect = [0 1 2 3 4 5 6 7 8]
PlntTransGearRatioVect = [1 4.75 3.75 3.25 2.75 2.25 1.5 1 0.75]
PlntTransInDamp = 0.001
PlntTransInInertia = 0.21
PlntTransInertiaVect = [0.2 0.28 0.24 0.2 0.18 0.11 0.11 0.11 0.11]
PlntTransInitGear = 1
PlntTransInitInTrq = 0
PlntTransInitInVel = 0
PlntTransInitNtrlInVel = 0
PlntTransInitOutVel = 0
PlntTransK = Simulink.Parameter(2000)
PlntTransRvrseGearEff = 0.9
PlntTransRvrseGearRatio = -3
PlntTransShftTimeCnst = 0.1
PlntTrnsfrCaseAxl1Damp = 0.001

PlntTrnsfrCaseAxl1Inertia = 0.1
PlntTrnsfrCaseAxl1InitVel = 0
PlntTrnsfrCaseAxl2Damp = 0.001
PlntTrnsfrCaseAxl2Inertia = 0.1
PlntTrnsfrCaseAxl2InitVel = 0
PlntTrnsfrCaseAxlSpdLock = 0
PlntTrnsfrCaseCarrDamp = 0.001
PlntTrnsfrCaseCarrInertia = 0.1
PlntTrnsfrCaseCltchDerateFctr = 1
PlntTrnsfrCaseCltchEffRad = 130
PlntTrnsfrCaseCltchEngdPstnArea = 0.001
PlntTrnsfrCaseCltchEngdThreshPrs = 100
PlntTrnsfrCaseCltchKinFric = 0.3
PlntTrnsfrCaseCltchNumFricSurf = 4
PlntTrnsfrCaseCltchStatFric = 0.35
PlntTrnsfrCaseCltchViscDragTrq = 0
PlntTrnsfrCaseCompCoulFricTrq = 0
PlntTrnsfrCaseCompInitDef = 0
PlntTrnsfrCaseCompStatKinFricRatio = 1.1
PlntTrnsfrCaseEff = 0.98
PlntTrnsfrCasePlanetSunRatio = 1
PlntTrnsfrCaseRatio = 1
PlntTrnsfrCaseTrqSplitRatio = 0.5
PlntTrnsfrCaseTrqSplitTimeCnst = 0.0001
PlntTrqConvrtrCapVect = [12.2938 12.8588 13.1452 13.6285 14.6163 16.2675 19.3503 22.1046 29.9986 50]
PlntTrqConvrtrCltchDerateFctr = 1
PlntTrqConvrtrCltchEngdThreshPrs = 100
PlntTrqConvrtrCltchKinFric = 0.4
PlntTrqConvrtrCltchLckUpForceGain = 10000
PlntTrqConvrtrCltchLckUpSpdRatio = 0.85
PlntTrqConvrtrCltchLckUpTimeCnst = 0.25
PlntTrqConvrtrCltchMinGear = 2
PlntTrqConvrtrCltchMinLckUpDisengdSpd = 83.7758
PlntTrqConvrtrCltchMinLckUpEngdSpd = 94.24778
PlntTrqConvrtrCltchMinSpd = 60
PlntTrqConvrtrCltchNumFricSurf = 6
PlntTrqConvrtrCltchRadius = 0.11
PlntTrqConvrtrCltchStatFric = 0.45
PlntTrqConvrtrCltchViscDragTrq = 0
PlntTrqConvrtrImpDamp = 0.001
PlntTrqConvrtrImpInertia = 0.21
PlntTrqConvrtrImpInitVel = 0
PlntTrqConvrtrSpdRatioVect = [0 0.5 0.6 0.7 0.8 0.87 0.92 0.94 0.96 0.97]
PlntTrqConvrtrTrqRatioVect = [2.232 1.5462 1.4058 1.2746 1.1528 1.0732 1.0192 0.9983 0.9983 0.9983]
PlntTrqConvrtrTurbDamp = 0.001
PlntTrqConvrtrTurbInertia = 0.01
PlntTrqConvrtrTurbInitVel = 0
PlntDiffrntl2PwrThresh = 20
PlntDiffrntlPwrThresh = 20
PlntHevIpsP2PwrThresh = 20
PlntHevMmGenGearPwrThresh = 20
PlntHevMmMotGearPwrThresh = 20
PlntTransPwrThresh = 20
PlntTrnsfrCasePwrThresh = 20
PlntEngInertia = 0.21
PlntP0GearEff = 0.98
PlntP0GearPwrThresh = 20
PlntHevIpsP1GearEff = [0.98 0.98]
PlntHevIpsP1GearPwrThresh = [20 20]
PlntTransCltchStatFricTrq = 5000
PlntTrqConvrtrInitTrqRatio = 0
PlntTrqConvrtrTimeCnst = 0.02
PlntTrqConvrtrCltchPrs = 1400000
PlntTrqConvrtrCltchEngdPstnArea = 0.01
PlntTrqConvrtrModeTransThresh = 1
PlntTrqConvrtrCoastModeCapFctrRatioVect = [5.079e-05 4.643e-5 4.442e-5 4.133e-5 3.593e-5 2.901e-05 2.05e-5 1.571e-5 8.53e-6 3.07e-06 0]
PlntTrqConvrtrCoastModeSpdRatioVect = [0 0.5 0.6 0.7 0.8 0.87 0.92 0.94 0.96 0.97 1]
PlntTrqConvrtrDrvModeCapFctrVect = [7.2558e-5 6.6322e-5 6.3463e-05 5.9042e-05 5.1331e-05 4.144e-5 2.9287e-05 2.2444e-5 1.2186e-5 4.386e-06 0]
PlntTrqConvrtrDrvModeTrqRatioVect = [2.232 1.5462 1.4058 1.2746 1.1528 1.0732 1.0192 1 1 1 1]
PlntTrqConvrtrDrvModeSpdRatioVect = [0 0.5 0.6 0.7 0.8 0.87 0.92 0.94 0.96 0.97 1]
PlntDiffrntl2Ratio = 3.32
PlntDiffrntlCltchVelTol = 0.1
PlntCltch1VelTol = 0.1
PlntDiffrntl2CltchVelTol = 0.1
PlntTransCltchVelTol = 0.1
PlntTrnsfrCaseCltchVelTol = 0.1
PlntTrnsfrCaseCompVelTol = 0.1
PlntTrqConvrtrCltchVelTol = 0.1
PlntTransDamp = 1
PlntTransStiff = 1
PlntTransShaftStiff = 10000
PlntTransShaftDamp = 400
PlntTransCltchShiftTime = 300
PlntAxlShaftStiff = 10000
PlntAxlShaftDamp = 400
PlntTrnsfrCaseCompStiff = 10000
PlntTrnsfrCaseCompViscFric = 400
CtrlVcuCltch1InitCmd = 0
PlntDriveshftDamp = 100
PlntDriveshftDampCutoffFreq = 100
CtrlTcuUpShSpd = reshape([5 8 14 20.74568 10.54094 16.19551 28.08489 50.24568 24.04094 29.69551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], 4, 7, 2)
CtrlTcuDnShSpd = reshape([2 4 8 17.37068 7.165944 12.82051 24.70989 46.87068 20.66594 26.32051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], 4, 7, 2)
CtrlTcuPedalOffset = Simulink.Parameter([0; 0; 0; 0])
CtrlTcuGearOffset = Simulink.Parameter(repmat(0, 1, 7))
CtrlTcuLugSpd = 1200
CtrlTcuInitGear = 0
CtrlTcuMinUpSpd = 1000
PlntHevIpsP1CarrRadius = 0.01
PlntHevIpsP1PlanetMass = 0.001